# Grasshopper definition 20221003_meshsubd_city_engine.gh (Grasshopper 1.0.7)

add_path = GhPythonScript(mola_path="C:\D\GitHub", toggle=Toggle(True))  # -> out, a; inputs seed: Int32
# ---------- add_path: Python ----------
__author__ = "Wen"
__version__ = "2022.10.03"

import sys
import os

if mola_path not in sys.path:
    sys.path.append(mola_path)

# find .py file within the same folder of .gh file
ghComp = ghenv.Component
ghDoc = ghComp.OnPingDocument()
gh_file_location = ghDoc.FilePath

parent = os.path.dirname(os.path.realpath(gh_file_location))
file_name = "20221003_meshsubd_city_engine.py"
file_path = os.path.join(parent, file_name)

# execute .py
if toggle:
    execfile(file_path)
# ---------- end add_path ----------
geometry = Geometry(add_path.a)
mesh_edges = MeshEdges(Mesh=geometry)  # -> NakedEdges, InteriorEdges, NonManifoldEdges
