# Grasshopper definition 20221003_meshsubd_gradation.gh (Grasshopper 1.0.7)

add_path = GhPythonScript(mola_path="C:\D\GitHub", toggle=Toggle(True))  # -> out, a
# ---------- add_path: Python ----------
__author__ = "Wen"
__version__ = "2022.10.03"

import sys
import os

if mola_path not in sys.path:
    sys.path.append(mola_path)

ghComp = ghenv.Component
ghDoc = ghComp.OnPingDocument()
gh_file_location = ghDoc.FilePath

parent = os.path.dirname(os.path.realpath(gh_file_location))
file_name = "20221003_meshsubd_gradation.py"
file_path = os.path.join(parent, file_name)

if toggle:
    execfile(file_path)
# ---------- end add_path ----------
mesh_edges = MeshEdges(Mesh=add_path.a)  # -> NakedEdges, InteriorEdges, NonManifoldEdges; disabled
