# Grasshopper definition 20221017_workflow_example.gh (Grasshopper 1.0.7)
# plug-ins: Axolotl Info

# ---- group: CSG
# Primitives
X = UnitX(Factor=1)
Y = UnitY(Factor=1)
Z = UnitZ(Factor=1)
number_slider = Slider(9, range=0..10)
pl = PlaneNormal(Origin=Point(0, 0, 0), ZAxis=[X, Y, Z])
box = Box(DimensionX=number_slider, DimensionY=number_slider, DimensionZ=number_slider, Radius=0, Plane=PlaneXY(0, 0, 0))
sphere = Sphere(Radius=Slider(6, range=0..10), Center=Point(0, 0, 0))
cylinder = Cylinder(Radius=Slider(3, range=0..10), Height=Slider(12, range=0..20), Plane=pl, Fillet=0)

# ----
# Brick Wall
number_slider_2 = Slider(5, range=0..10)
neg = Negative(Value=number_slider_2)
dom = ConstructDomain(DomainStart=neg, DomainEnd=number_slider_2)
xz = XZPlane(Origin=Point(0, 0, 0))
multiplication = Multiplication(A=number_slider_2, B="2")
rectangle = Rectangle(Plane=xz, XSize=dom, YSize=dom, Radius=0)  # -> Rectangle, Length
morter = Slider(0.2, range=0..2)
pt = ConstructPoint(XCoordinate=0, YCoordinate=0, ZCoordinate=0)
thickness = Slider(1.2, range=0..5)
arrrec = RectangularArray(Geometry=pt, Cell=rectangle.Rectangle, XCount=Slider(8, range=0..10), YCount=Slider(5, range=0..10))  # -> Geometry, Transform
subtraction = Subtraction(A=multiplication, B=morter)
xz_2 = XZPlane(Origin=arrrec.Geometry)
subtraction_2 = Subtraction(A=subtraction, B=thickness)
box_2 = Box(DimensionX=subtraction, DimensionY=subtraction, DimensionZ=subtraction, Radius=0, Plane=xz_2)
box_3 = Box(DimensionX=subtraction_2, DimensionY=subtraction_2, DimensionZ=subtraction, Radius=0, Plane=xz_2)

number_slider_3 = Slider(3, range=0..10)  # disabled

# ----
# Random Planes for Edges
number_slider_4 = Slider(9, range=0..10)  # disabled
number_slider_5 = Slider(3.4, range=0..10)  # disabled
sph = Sphere(Base=PlaneXY(0, 0, 0), Radius=number_slider_5)  # disabled
popgeo = PopulateGeometry(Geometry=sph, Count=number_slider_4, Seed=1)  # disabled
pl_2 = PlaneNormal(Origin=popgeo, ZAxis=popgeo)  # disabled

# ----
# Bounding Box
number_slider_6 = Slider(5, range=0..10)  # disabled
neg_2 = Negative(Value=number_slider_6)  # disabled
dom_2 = ConstructDomain(DomainStart=neg_2, DomainEnd=number_slider_6)  # disabled
box_4 = DomainBox(Base=PlaneXY(0, 0, 0), X=dom_2, Y=dom_2, Z=dom_2)  # disabled
edges = BrepEdges(Brep=box_4)  # -> Naked, Interior, NonManifold; disabled

# ---- group: CSG
# Boolean Operators
boolean_intersect = BooleanIntersect(DistanceObjectS=sphere, DistanceObject=box)
boolean_union = BooleanUnion(DistanceObjectS=cylinder)
boolean_subtract = BooleanSubtract(DistanceObject=boolean_intersect, DistanceObject_2=boolean_union)

# ----
# Square edge profiles
# Blended smoothly with a central sphere
dimension_x_y = Slider(1.5, range=0..10)  # disabled
number_slider_7 = Slider(3.5, range=0..10)  # disabled
number_slider_8 = Slider(0.3, range=0..1)  # disabled
number_slider_9 = Slider(2, range=0..10)  # disabled
box_5 = Box(DimensionX=dimension_x_y, DimensionY=dimension_x_y, DimensionZ=number_slider_7, Radius=number_slider_8, Plane=pl_2)  # disabled
number_slider_10 = Slider(10, range=0..10)  # disabled
boolean_union_2 = BooleanUnion(DistanceObjectS=box_5)  # disabled
sphere_2 = Sphere(Radius=number_slider_9, Center=Point(0, 0, 0))  # disabled
smoothunionlist = SmoothUnionList(DistanceObjects=flatten([boolean_union_2, sphere_2]), SmoothingFactor=number_slider_10)  # disabled

number_slider_11 = Slider(100, range=0..1000)
# Octree Meshing
isosurface_distancefunction = IsosurfaceDistancefunction(
    NumberX=number_slider_11,
    NumberY=number_slider_11,
    NumberZ=number_slider_11,
    Isovalue=0,
    Capped=False,
    DistanceObject=boolean_subtract,
    Refine=True)
preview = CustomPreview(Geometry=isosurface_distancefunction, Material=ColourSwatch(SwatchColor=RGB(238, 102, 121)))

# ----
# Inner Lattices
number_slider_12 = Slider(0.35, range=0..1)
tpms = TPMS(Wavelength=Slider(13, range=0..100), type=0)
shell = Shell(DistanceObject=tpms, Thickness=number_slider_12, Factor=0.5)
boolean_intersect_2 = BooleanIntersect(DistanceObjectS=graft(box_3), DistanceObject=shell)

number_slider_13 = Slider(21, range=0..100)

# ----
# Create shell and cut off tips
number_slider_14 = Slider(4.8, range=0..10)  # disabled
number_slider_15 = Slider(0.2, range=0..1)  # disabled
number_slider_16 = Slider(1, range=0..2)  # disabled
shell_2 = Shell(DistanceObject=smoothunionlist, Thickness=number_slider_15, Factor=number_slider_16)  # disabled
sphere_3 = Sphere(Radius=number_slider_14, Center=Point(0, 0, 0))  # disabled
boolean_intersect_3 = BooleanIntersect(DistanceObjectS=sphere_3, DistanceObject=shell_2)  # disabled

dense_grid = DenseGrid(
    DistanceObject=boolean_subtract,
    Box={Plane=PlaneXY(0, 0, 0), X=Domain(-5, 5), Y=Domain(-5, 5), Z=Domain(-5, 5)},
    NumberX=number_slider_13,
    NumberY=number_slider_13,
    NumberZ=number_slider_13,
    type=0)  # -> Values, Points

boolean_subtract_2 = BooleanSubtract(DistanceObject=box_2, DistanceObject_2=box_3)
boolean_union_3 = BooleanUnion(DistanceObjectS=graft(boolean_subtract_2), DistanceObject=boolean_intersect_2)  # -> flatten(D)

# ----
# Bounding Box
panel = Panel("5")
box_6 = CenterBox(Base=arrrec.Geometry, X=panel, Y=panel, Z=panel)

smaller_than = SmallerThan(FirstNumber=dense_grid.Values, SecondNumber=Slider(0, range=0..100))  # -> SmallerThan, OrEqualTo
number_slider_17 = Slider(0.25, range=0..1)

# ----
# Isosurface Meshing
number_slider_18 = Slider(150, range=0..200)  # disabled
isosurface_distancefunction_2 = IsosurfaceDistancefunction(
    NumberX=number_slider_18,
    NumberY=number_slider_18,
    NumberZ=number_slider_18,
    Isovalue=0,
    Capped=False,
    DistanceObject=boolean_intersect_3,
    Refine=True)  # disabled
swatch = ColourSwatch(SwatchColor=RGB(238, 102, 121))  # disabled
preview_2 = CustomPreview(Geometry=isosurface_distancefunction_2, Material=swatch)  # disabled

cull_pattern = CullPattern(List=dense_grid.Points, CullPattern=smaller_than.SmallerThan)

# ----
# Isosurface Meshing
number_slider_19 = Slider(45, range=0..100)
isosurface_distancefunction_3 = IsosurfaceDistancefunction(
    BoundingBox=box_6,
    NumberX=number_slider_19,
    NumberY=number_slider_19,
    NumberZ=number_slider_19,
    Isovalue=0,
    Capped=False,
    DistanceObject=boolean_union_3,
    Refine=True)
preview_3 = CustomPreview(Geometry=isosurface_distancefunction_3, Material=ColourSwatch(SwatchColor=RGB(238, 102, 121)))

center_box = CenterBox(Base=cull_pattern, X=number_slider_17, Y=number_slider_17, Z=number_slider_17)
mesh_brep = MeshBrep(
    Brep=center_box,
    Settings={GridMaxCount=0, GridMinCount=16, JaggedSeams=False, MaxEdgeLength=0, MinEdgeLength=0.0001, MinTolerance=0, Refine=True, RefineAngle=0, RelativeTolerance=0.65, SimplePlanes=True, Tolerance=0})
list_item = ListItem(List=mesh_brep, Index=0, Wrap=True)
add_path = GhPythonScript(mola_path="C:\D\GitHub", toggle=Toggle(False), rhino_mesh=list_item)  # -> out, a; inputs rhino_mesh: Mesh, seed: Int32
# ---------- add_path: Python ----------
__author__ = "Wen"
__version__ = "2022.10.03"

import sys
import os

if mola_path not in sys.path:
    sys.path.append(mola_path)

# find .py file within the same folder of .gh file
ghComp = ghenv.Component
ghDoc = ghComp.OnPingDocument()
gh_file_location = ghDoc.FilePath

parent = os.path.dirname(os.path.realpath(gh_file_location))
file_name = "20221017_meshsubd.py"
file_path = os.path.join(parent, file_name)

# execute .py
if toggle:
    execfile(file_path)
# ---------- end add_path ----------
geometry = Geometry(add_path.a)

# ----
# Outer Shape
number_slider_20 = Slider(25, range=0..100)  # disabled
sph_2 = Sphere(Base=PlaneXY(0, 0, 0), Radius=number_slider_3)  # disabled
popgeo_2 = PopulateGeometry(Geometry=sph_2, Count=number_slider_20, Seed=1)  # disabled
number_slider_21 = Slider(0.2, range=0..1)  # disabled
number_slider_22 = Slider(200, range=0..300)  # disabled
swatch_2 = ColourSwatch(SwatchColor=RGBA(237, 102, 120, 128))  # disabled

plane = Plane(Origin=popgeo_2, Normal=popgeo_2)  # disabled

boolean_intersect_4 = BooleanIntersect(DistanceObjectS=plane)  # disabled
shell_3 = Shell(DistanceObject=boolean_intersect_4, Thickness=number_slider_21, Factor=0)  # disabled
isosurface_distancefunction_4 = IsosurfaceDistancefunction(
    BoundingBox=box_4,
    NumberX=number_slider_22,
    NumberY=number_slider_22,
    NumberZ=number_slider_22,
    Isovalue=0,
    Capped=False,
    DistanceObject=shell_3,
    Refine=True)  # disabled
preview_4 = CustomPreview(Geometry=isosurface_distancefunction_4, Material=swatch_2)  # disabled

# ----
# Inner Lattices
number_slider_23 = Slider(0.2, range=0..1)  # disabled
number_slider_24 = Slider(1, range=0..10)  # disabled
number_slider_25 = Slider(200, range=0..300)  # disabled
lattice = Lattice(Cellsize=number_slider_24, Thickness=number_slider_23, type=0)  # disabled
boolean_intersect_5 = BooleanIntersect(DistanceObjectS=boolean_intersect_4, DistanceObject=lattice)  # disabled
isosurface_distancefunction_5 = IsosurfaceDistancefunction(
    BoundingBox=box_4,
    NumberX=number_slider_25,
    NumberY=number_slider_25,
    NumberZ=number_slider_25,
    Isovalue=0,
    Capped=False,
    DistanceObject=boolean_intersect_5,
    Refine=True)  # disabled
swatch_3 = ColourSwatch(SwatchColor=RGB(238, 102, 121))  # disabled
preview_5 = CustomPreview(Geometry=isosurface_distancefunction_5, Material=swatch_3)  # disabled
